# Grasshopper definition 211103_Vertically Optimization.gh (Grasshopper 1.0.7)

number_slider = Slider(0.67, range=0..1)
number_slider_2 = Slider(0.85, range=0..1)
number_slider_3 = Slider(0.09, range=0..1)
number_slider_4 = Slider(0.72, range=0..1)
number_slider_5 = Slider(0.21, range=0..1)
number_slider_6 = Slider(0.62, range=0..1)
number_slider_7 = Slider(0.3, range=0..1)
number_slider_8 = Slider(0.3, range=0..1)
number_slider_9 = Slider(0.17, range=0..1)
number_slider_10 = Slider(0.13, range=0..1)
number_slider_11 = Slider(1, range=0..1)
number_slider_12 = Slider(0.9, range=0..1)
number_slider_13 = Slider(0.81, range=0..1)
number_slider_14 = Slider(0.96, range=0..1)
number_slider_15 = Slider(0.08, range=0..1)
number_slider_16 = Slider(0.78, range=0..1)
number_slider_17 = Slider(0, range=0..1)
number_slider_18 = Slider(0.5, range=0..1)
number_slider_19 = Slider(0.41, range=0..1)
number_slider_20 = Slider(0.82, range=0..1)
number_slider_21 = Slider(0.62, range=0..1)
crv = Curve([<curve referenced from the Rhino model> x21])
crv_2 = Curve(<curve referenced from the Rhino model>)
id = Guid(crv)
dam = DataDam(DataA=[crv, crv_2], BufferDelay=2500000, BufferMode=2)
panel = Panel(id)
id_2 = Guid(dam)
remap = RemapNumbers(
    Value=[number_slider_4, number_slider_2, number_slider_3, number_slider_5, number_slider_6, number_slider_7, number_slider_8, number_slider_9, number_slider_10, number_slider_11, number_slider_12, number_slider_13, number_slider_14, number_slider_15, number_slider_16, number_slider_17, number_slider_18, number_slider_19, Slider(0, range=0..1), number_slider, number_slider_21, number_slider_20],
    Source=Domain(0, 1),
    Target="32")  # -> Mapped, Clipped
panel_2 = Panel("""2
4
4
1
0
1
0
0
0
2
0
1
1
2
2
1
1
0
0
0
0
3""")
getnames = PythonScript(Objs=flatten(dam), GUID=id_2)  # -> out, ObjectsSorted, ObjNamesSorted; inputs Objs: list, GUID: list
# ---------- getnames: Python ----------
"""
This is used to grab some info from the Rhino Scene and bring it into the Grasshopper environment

-
Ed May
December 9, 2018

    Args:
        _Objs: Pass in a list of objects from the Rhino Scene. Can be any Rhino object (Brep, Surface, Curve, etc..)
        _GUID: Connect a grasshopper 'ID' component here to pass in the GUID of the Rhino Objects
    Returns:
        out:...
        ObjectsSorted_: A list of the objects, but sorted by their names
        ObjNamesSorted_: A list of the object names, sorted
"""




import rhinoscriptsyntax as rs
import scriptcontext as sc
import Rhino

#setup variables for use later
ObjNames_ = []
ObjectsSorted_ = []

#go to Rhino document to pick blocks from there
sc.doc = Rhino.RhinoDoc.ActiveDoc

for i in range(len(_GUID)):
    ObjNames_.append(rs.ObjectName(_GUID[i]))

# switch back to Grasshopper document
sc.doc = ghdoc

#Sort the incloming curves to match the object names
ObjNamesSorted_ = sorted(ObjNames_)

for i in range(len(ObjNamesSorted_)):
    for j in range(len(ObjNames_)):
        if ObjNames_[j] == ObjNamesSorted_[i]:
            ObjectsSorted_.append(_Objs[j])
# ---------- end getnames ----------
panel_3 = Panel(remap.Mapped)
merge = Merge(Data1=graft(getnames.ObjectsSorted), Data2=graft(getnames.ObjNamesSorted), Data3=graft(remap.Mapped))  # -> simplify(Result)
item = ListItem(List=merge, Index=Slider(2, range=0..5), Wrap=True)
item_2 = ListItem(List=merge, Index=Slider(0, range=0..5), Wrap=True)
item_3 = ListItem(List=merge, Index=Slider(1, range=0..5), Wrap=True)
Z = UnitZ(Factor=item)
move = Move(Geometry=item_2, Motion=Z)  # -> Geometry, Transform

split = SplitTree(Data=move.Geometry, Masks=flatten("{6}[*]"))  # -> Positive, Negative
split_2 = SplitTree(Data=move.Geometry, Masks=flatten("{18}[*]"))  # -> Positive, Negative
split_3 = SplitTree(Data=move.Geometry, Masks=flatten("{6}[*]"))  # -> Positive, Negative
split_4 = SplitTree(Data=move.Geometry, Masks=flatten("{9}[*]"))  # -> Positive, Negative
split_5 = SplitTree(Data=move.Geometry, Masks=flatten("{11}[*]"))  # -> Positive, Negative
split_6 = SplitTree(Data=move.Geometry, Masks=flatten("{9}[*]"))  # -> Positive, Negative
split_7 = SplitTree(Data=move.Geometry, Masks=flatten("{9}[*]"))  # -> Positive, Negative
split_8 = SplitTree(Data=move.Geometry, Masks=flatten("{18}[*]"))  # -> Positive, Negative
split_9 = SplitTree(Data=move.Geometry, Masks=flatten("{13}[*]"))  # -> Positive, Negative
split_10 = SplitTree(Data=move.Geometry, Masks=flatten("{11}[*]"))  # -> Positive, Negative
split_11 = SplitTree(Data=move.Geometry, Masks=flatten("{11}[*]"))  # -> Positive, Negative
split_12 = SplitTree(Data=move.Geometry, Masks=flatten("{17}[*]"))  # -> Positive, Negative
clean = CleanTree(RemoveNulls=True, RemoveInvalid=True, RemoveEmpty=False, Tree=flatten(split.Positive))
clean_2 = CleanTree(RemoveNulls=True, RemoveInvalid=True, RemoveEmpty=False, Tree=flatten(split_2.Positive))
clean_3 = CleanTree(RemoveNulls=True, RemoveInvalid=True, RemoveEmpty=False, Tree=flatten(split_3.Positive))
clean_4 = CleanTree(RemoveNulls=True, RemoveInvalid=True, RemoveEmpty=False, Tree=flatten(split_4.Positive))
clean_5 = CleanTree(RemoveNulls=True, RemoveInvalid=True, RemoveEmpty=False, Tree=flatten(split_7.Positive))
clean_6 = CleanTree(RemoveNulls=True, RemoveInvalid=True, RemoveEmpty=False, Tree=flatten(split_5.Positive))
clean_7 = CleanTree(RemoveNulls=True, RemoveInvalid=True, RemoveEmpty=False, Tree=flatten(split_6.Positive))
clean_8 = CleanTree(RemoveNulls=True, RemoveInvalid=True, RemoveEmpty=False, Tree=flatten(split_8.Positive))
clean_9 = CleanTree(RemoveNulls=True, RemoveInvalid=True, RemoveEmpty=False, Tree=flatten(split_9.Positive))
clean_10 = CleanTree(RemoveNulls=True, RemoveInvalid=True, RemoveEmpty=False, Tree=flatten(split_10.Positive))
clean_11 = CleanTree(RemoveNulls=True, RemoveInvalid=True, RemoveEmpty=False, Tree=flatten(split_11.Positive))
clean_12 = CleanTree(RemoveNulls=True, RemoveInvalid=True, RemoveEmpty=False, Tree=flatten(split_12.Positive))
area = Area(Geometry=clean)  # -> Area, Centroid
crv_cp = CurveClosestPoint(Point=area.Centroid, Curve=clean_2)  # -> Point, Parameter, Distance
area_2 = Area(Geometry=clean_3)  # -> Area, Centroid
area_3 = Area(Geometry=clean_4)  # -> Area, Centroid
area_4 = Area(Geometry=clean_7)  # -> Area, Centroid
area_5 = Area(Geometry=clean_5)  # -> Area, Centroid
area_6 = Area(Geometry=clean_6)  # -> Area, Centroid
crv_cp_2 = CurveClosestPoint(Point=area_4.Centroid, Curve=clean_8)  # -> Point, Parameter, Distance
area_7 = Area(Geometry=clean_9)  # -> Area, Centroid
area_8 = Area(Geometry=clean_10)  # -> Area, Centroid
area_9 = Area(Geometry=clean_11)  # -> Area, Centroid
area_10 = Area(Geometry=clean_12)  # -> Area, Centroid
ln = Line(StartPoint=crv_cp.Point, EndPoint=area.Centroid)
ln_2 = Line(StartPoint=area_2.Centroid, EndPoint=area_5.Centroid)
ln_3 = Line(StartPoint=area_3.Centroid, EndPoint=area_6.Centroid)
ln_4 = Line(StartPoint=area_4.Centroid, EndPoint=crv_cp_2.Point)
ln_5 = Line(StartPoint=area_7.Centroid, EndPoint=area_8.Centroid)
ln_6 = Line(StartPoint=area_9.Centroid, EndPoint=area_10.Centroid)
split_13 = SplitTree(Data=move.Geometry, Masks=flatten("{11}[*]"))  # -> Positive, Negative
split_14 = SplitTree(Data=move.Geometry, Masks=flatten("{19}[*]"))  # -> Positive, Negative
split_15 = SplitTree(Data=move.Geometry, Masks=flatten("{19}[*]"))  # -> Positive, Negative
split_16 = SplitTree(Data=move.Geometry, Masks=flatten("{8}[*]"))  # -> Positive, Negative
split_17 = SplitTree(Data=move.Geometry, Masks=flatten("{19}[*]"))  # -> Positive, Negative
split_18 = SplitTree(Data=move.Geometry, Masks=flatten("{20}[*]"))  # -> Positive, Negative
split_19 = SplitTree(Data=move.Geometry, Masks=flatten("{8}[*]"))  # -> Positive, Negative
split_20 = SplitTree(Data=move.Geometry, Masks=flatten("{20}[*]"))  # -> Positive, Negative
split_21 = SplitTree(Data=move.Geometry, Masks=flatten("{19}[*]"))  # -> Positive, Negative
split_22 = SplitTree(Data=move.Geometry, Masks=flatten("{10}[*]"))  # -> Positive, Negative
split_23 = SplitTree(Data=move.Geometry, Masks=flatten("{19}[*]"))  # -> Positive, Negative
split_24 = SplitTree(Data=move.Geometry, Masks=flatten("{0}[*]"))  # -> Positive, Negative
clean_13 = CleanTree(RemoveNulls=True, RemoveInvalid=True, RemoveEmpty=False, Tree=flatten(split_13.Positive))
clean_14 = CleanTree(RemoveNulls=True, RemoveInvalid=True, RemoveEmpty=False, Tree=flatten(split_14.Positive))
clean_15 = CleanTree(RemoveNulls=True, RemoveInvalid=True, RemoveEmpty=False, Tree=flatten(split_15.Positive))
clean_16 = CleanTree(RemoveNulls=True, RemoveInvalid=True, RemoveEmpty=False, Tree=flatten(split_16.Positive))
clean_17 = CleanTree(RemoveNulls=True, RemoveInvalid=True, RemoveEmpty=False, Tree=flatten(split_17.Positive))
clean_18 = CleanTree(RemoveNulls=True, RemoveInvalid=True, RemoveEmpty=False, Tree=flatten(split_18.Positive))
clean_19 = CleanTree(RemoveNulls=True, RemoveInvalid=True, RemoveEmpty=False, Tree=flatten(split_19.Positive))
clean_20 = CleanTree(RemoveNulls=True, RemoveInvalid=True, RemoveEmpty=False, Tree=flatten(split_20.Positive))
clean_21 = CleanTree(RemoveNulls=True, RemoveInvalid=True, RemoveEmpty=False, Tree=flatten(split_21.Positive))
clean_22 = CleanTree(RemoveNulls=True, RemoveInvalid=True, RemoveEmpty=False, Tree=flatten(split_22.Positive))
clean_23 = CleanTree(RemoveNulls=True, RemoveInvalid=True, RemoveEmpty=False, Tree=flatten(split_23.Positive))
clean_24 = CleanTree(RemoveNulls=True, RemoveInvalid=True, RemoveEmpty=False, Tree=flatten(split_24.Positive))
area_11 = Area(Geometry=clean_13)  # -> Area, Centroid
area_12 = Area(Geometry=clean_14)  # -> Area, Centroid
area_13 = Area(Geometry=clean_15)  # -> Area, Centroid
area_14 = Area(Geometry=clean_16)  # -> Area, Centroid
area_15 = Area(Geometry=clean_17)  # -> Area, Centroid
area_16 = Area(Geometry=clean_19)  # -> Area, Centroid
area_17 = Area(Geometry=clean_20)  # -> Area, Centroid
area_18 = Area(Geometry=clean_23)  # -> Area, Centroid
area_19 = Area(Geometry=clean_18)  # -> Area, Centroid
area_20 = Area(Geometry=clean_21)  # -> Area, Centroid
area_21 = Area(Geometry=clean_22)  # -> Area, Centroid
area_22 = Area(Geometry=clean_24)  # -> Area, Centroid
ln_7 = Line(StartPoint=area_11.Centroid, EndPoint=area_12.Centroid)
ln_8 = Line(StartPoint=area_13.Centroid, EndPoint=area_14.Centroid)
ln_9 = Line(StartPoint=area_15.Centroid, EndPoint=area_19.Centroid)
ln_10 = Line(StartPoint=area_16.Centroid, EndPoint=area_20.Centroid)
ln_11 = Line(StartPoint=area_17.Centroid, EndPoint=area_21.Centroid)
ln_12 = Line(StartPoint=area_18.Centroid, EndPoint=area_22.Centroid)
split_25 = SplitTree(Data=move.Geometry, Masks=flatten("{10}[*]"))  # -> Positive, Negative
split_26 = SplitTree(Data=move.Geometry, Masks=flatten("{10}[*]"))  # -> Positive, Negative
split_27 = SplitTree(Data=move.Geometry, Masks=flatten("{20}[*]"))  # -> Positive, Negative
split_28 = SplitTree(Data=move.Geometry, Masks=flatten("{19}[*]"))  # -> Positive, Negative
split_29 = SplitTree(Data=move.Geometry, Masks=flatten("{17}[*]"))  # -> Positive, Negative
split_30 = SplitTree(Data=move.Geometry, Masks=flatten("{21}[*]"))  # -> Positive, Negative
split_31 = SplitTree(Data=move.Geometry, Masks=flatten("{21}[*]"))  # -> Positive, Negative
split_32 = SplitTree(Data=move.Geometry, Masks=flatten("{20}[*]"))  # -> Positive, Negative
split_33 = SplitTree(Data=move.Geometry, Masks=flatten("{21}[*]"))  # -> Positive, Negative
split_34 = SplitTree(Data=move.Geometry, Masks=flatten("{1}[*]"))  # -> Positive, Negative
split_35 = SplitTree(Data=move.Geometry, Masks=flatten("{1}[*]"))  # -> Positive, Negative
split_36 = SplitTree(Data=move.Geometry, Masks=flatten("{4}[*]"))  # -> Positive, Negative
clean_25 = CleanTree(RemoveNulls=True, RemoveInvalid=True, RemoveEmpty=False, Tree=flatten(split_25.Positive))
clean_26 = CleanTree(RemoveNulls=True, RemoveInvalid=True, RemoveEmpty=False, Tree=flatten(split_26.Positive))
clean_27 = CleanTree(RemoveNulls=True, RemoveInvalid=True, RemoveEmpty=False, Tree=flatten(split_27.Positive))
clean_28 = CleanTree(RemoveNulls=True, RemoveInvalid=True, RemoveEmpty=False, Tree=flatten(split_28.Positive))
clean_29 = CleanTree(RemoveNulls=True, RemoveInvalid=True, RemoveEmpty=False, Tree=flatten(split_29.Positive))
clean_30 = CleanTree(RemoveNulls=True, RemoveInvalid=True, RemoveEmpty=False, Tree=flatten(split_30.Positive))
clean_31 = CleanTree(RemoveNulls=True, RemoveInvalid=True, RemoveEmpty=False, Tree=flatten(split_31.Positive))
clean_32 = CleanTree(RemoveNulls=True, RemoveInvalid=True, RemoveEmpty=False, Tree=flatten(split_32.Positive))
clean_33 = CleanTree(RemoveNulls=True, RemoveInvalid=True, RemoveEmpty=False, Tree=flatten(split_33.Positive))
clean_34 = CleanTree(RemoveNulls=True, RemoveInvalid=True, RemoveEmpty=False, Tree=flatten(split_34.Positive))
clean_35 = CleanTree(RemoveNulls=True, RemoveInvalid=True, RemoveEmpty=False, Tree=flatten(split_35.Positive))
clean_36 = CleanTree(RemoveNulls=True, RemoveInvalid=True, RemoveEmpty=False, Tree=flatten(split_36.Positive))
area_23 = Area(Geometry=clean_25)  # -> Area, Centroid
area_24 = Area(Geometry=clean_26)  # -> Area, Centroid
area_25 = Area(Geometry=clean_29)  # -> Area, Centroid
area_26 = Area(Geometry=clean_27)  # -> Area, Centroid
area_27 = Area(Geometry=clean_28)  # -> Area, Centroid
area_28 = Area(Geometry=clean_30)  # -> Area, Centroid
area_29 = Area(Geometry=clean_31)  # -> Area, Centroid
area_30 = Area(Geometry=clean_32)  # -> Area, Centroid
area_31 = Area(Geometry=clean_33)  # -> Area, Centroid
area_32 = Area(Geometry=clean_34)  # -> Area, Centroid
area_33 = Area(Geometry=clean_35)  # -> Area, Centroid
area_34 = Area(Geometry=clean_36)  # -> Area, Centroid
ln_13 = Line(StartPoint=area_23.Centroid, EndPoint=area_26.Centroid)
ln_14 = Line(StartPoint=area_24.Centroid, EndPoint=area_27.Centroid)
ln_15 = Line(StartPoint=area_25.Centroid, EndPoint=area_28.Centroid)
ln_16 = Line(StartPoint=area_29.Centroid, EndPoint=area_30.Centroid)
ln_17 = Line(StartPoint=area_31.Centroid, EndPoint=area_32.Centroid)
ln_18 = Line(StartPoint=area_33.Centroid, EndPoint=area_34.Centroid)
split_37 = SplitTree(Data=move.Geometry, Masks=flatten("{1}[*]"))  # -> Positive, Negative
split_38 = SplitTree(Data=move.Geometry, Masks=flatten("{15}[*]"))  # -> Positive, Negative
split_39 = SplitTree(Data=move.Geometry, Masks=flatten("{15}[*]"))  # -> Positive, Negative
split_40 = SplitTree(Data=move.Geometry, Masks=flatten("{7}[*]"))  # -> Positive, Negative
split_41 = SplitTree(Data=move.Geometry, Masks=flatten("{20}[*]"))  # -> Positive, Negative
split_42 = SplitTree(Data=move.Geometry, Masks=flatten("{15}[*]"))  # -> Positive, Negative
split_43 = SplitTree(Data=move.Geometry, Masks=flatten("{20}[*]"))  # -> Positive, Negative
split_44 = SplitTree(Data=move.Geometry, Masks=flatten("{3}[*]"))  # -> Positive, Negative
split_45 = SplitTree(Data=move.Geometry, Masks=flatten("{12}[*]"))  # -> Positive, Negative
split_46 = SplitTree(Data=move.Geometry, Masks=flatten("{15}[*]"))  # -> Positive, Negative
split_47 = SplitTree(Data=move.Geometry, Masks=flatten("{14}[*]"))  # -> Positive, Negative
split_48 = SplitTree(Data=move.Geometry, Masks=flatten("{15}[*]"))  # -> Positive, Negative
clean_37 = CleanTree(RemoveNulls=True, RemoveInvalid=True, RemoveEmpty=False, Tree=flatten(split_37.Positive))
clean_38 = CleanTree(RemoveNulls=True, RemoveInvalid=True, RemoveEmpty=False, Tree=flatten(split_38.Positive))
clean_39 = CleanTree(RemoveNulls=True, RemoveInvalid=True, RemoveEmpty=False, Tree=flatten(split_39.Positive))
clean_40 = CleanTree(RemoveNulls=True, RemoveInvalid=True, RemoveEmpty=False, Tree=flatten(split_40.Positive))
clean_41 = CleanTree(RemoveNulls=True, RemoveInvalid=True, RemoveEmpty=False, Tree=flatten(split_41.Positive))
clean_42 = CleanTree(RemoveNulls=True, RemoveInvalid=True, RemoveEmpty=False, Tree=flatten(split_42.Positive))
clean_43 = CleanTree(RemoveNulls=True, RemoveInvalid=True, RemoveEmpty=False, Tree=flatten(split_43.Positive))
clean_44 = CleanTree(RemoveNulls=True, RemoveInvalid=True, RemoveEmpty=False, Tree=flatten(split_44.Positive))
clean_45 = CleanTree(RemoveNulls=True, RemoveInvalid=True, RemoveEmpty=False, Tree=flatten(split_45.Positive))
clean_46 = CleanTree(RemoveNulls=True, RemoveInvalid=True, RemoveEmpty=False, Tree=flatten(split_46.Positive))
clean_47 = CleanTree(RemoveNulls=True, RemoveInvalid=True, RemoveEmpty=False, Tree=flatten(split_47.Positive))
clean_48 = CleanTree(RemoveNulls=True, RemoveInvalid=True, RemoveEmpty=False, Tree=flatten(split_48.Positive))
area_35 = Area(Geometry=clean_37)  # -> Area, Centroid
area_36 = Area(Geometry=clean_38)  # -> Area, Centroid
area_37 = Area(Geometry=clean_39)  # -> Area, Centroid
area_38 = Area(Geometry=clean_41)  # -> Area, Centroid
area_39 = Area(Geometry=clean_43)  # -> Area, Centroid
area_40 = Area(Geometry=clean_40)  # -> Area, Centroid
area_41 = Area(Geometry=clean_45)  # -> Area, Centroid
area_42 = Area(Geometry=clean_47)  # -> Area, Centroid
area_43 = Area(Geometry=clean_42)  # -> Area, Centroid
area_44 = Area(Geometry=clean_44)  # -> Area, Centroid
area_45 = Area(Geometry=clean_46)  # -> Area, Centroid
area_46 = Area(Geometry=clean_48)  # -> Area, Centroid
ln_19 = Line(StartPoint=area_35.Centroid, EndPoint=area_36.Centroid)
ln_20 = Line(StartPoint=area_37.Centroid, EndPoint=area_40.Centroid)
ln_21 = Line(StartPoint=area_38.Centroid, EndPoint=area_43.Centroid)
ln_22 = Line(StartPoint=area_39.Centroid, EndPoint=area_44.Centroid)
ln_23 = Line(StartPoint=area_41.Centroid, EndPoint=area_45.Centroid)
ln_24 = Line(StartPoint=area_42.Centroid, EndPoint=area_46.Centroid)
split_49 = SplitTree(Data=move.Geometry, Masks=flatten("{15}[*]"))  # -> Positive, Negative
split_50 = SplitTree(Data=move.Geometry, Masks=flatten("{0}[*]"))  # -> Positive, Negative
split_51 = SplitTree(Data=move.Geometry, Masks=flatten("{5}[*]"))  # -> Positive, Negative
split_52 = SplitTree(Data=move.Geometry, Masks=flatten("{13}[*]"))  # -> Positive, Negative
split_53 = SplitTree(Data=move.Geometry, Masks=flatten("{5}[*]"))  # -> Positive, Negative
split_54 = SplitTree(Data=move.Geometry, Masks=flatten("{0}[*]"))  # -> Positive, Negative
split_55 = SplitTree(Data=move.Geometry, Masks=flatten("{16}[*]"))  # -> Positive, Negative
split_56 = SplitTree(Data=move.Geometry, Masks=flatten("{18}[*]"))  # -> Positive, Negative
split_57 = SplitTree(Data=move.Geometry, Masks=flatten("{15}[*]"))  # -> Positive, Negative
split_58 = SplitTree(Data=move.Geometry, Masks=flatten("{18}[*]"))  # -> Positive, Negative
clean_49 = CleanTree(RemoveNulls=True, RemoveInvalid=True, RemoveEmpty=False, Tree=flatten(split_49.Positive))
clean_50 = CleanTree(RemoveNulls=True, RemoveInvalid=True, RemoveEmpty=False, Tree=flatten(split_50.Positive))
clean_51 = CleanTree(RemoveNulls=True, RemoveInvalid=True, RemoveEmpty=False, Tree=flatten(split_51.Positive))
clean_52 = CleanTree(RemoveNulls=True, RemoveInvalid=True, RemoveEmpty=False, Tree=flatten(split_52.Positive))
clean_53 = CleanTree(RemoveNulls=True, RemoveInvalid=True, RemoveEmpty=False, Tree=flatten(split_53.Positive))
clean_54 = CleanTree(RemoveNulls=True, RemoveInvalid=True, RemoveEmpty=False, Tree=flatten(split_54.Positive))
clean_55 = CleanTree(RemoveNulls=True, RemoveInvalid=True, RemoveEmpty=False, Tree=flatten(split_55.Positive))
clean_56 = CleanTree(RemoveNulls=True, RemoveInvalid=True, RemoveEmpty=False, Tree=flatten(split_56.Positive))
clean_57 = CleanTree(RemoveNulls=True, RemoveInvalid=True, RemoveEmpty=False, Tree=flatten(split_57.Positive))
clean_58 = CleanTree(RemoveNulls=True, RemoveInvalid=True, RemoveEmpty=False, Tree=flatten(split_58.Positive))
area_47 = Area(Geometry=clean_49)  # -> Area, Centroid
area_48 = Area(Geometry=clean_50)  # -> Area, Centroid
area_49 = Area(Geometry=clean_53)  # -> Area, Centroid
area_50 = Area(Geometry=clean_54)  # -> Area, Centroid
area_51 = Area(Geometry=clean_51)  # -> Area, Centroid
area_52 = Area(Geometry=clean_52)  # -> Area, Centroid
crv_cp_3 = CurveClosestPoint(Point=area_50.Centroid, Curve=clean_56)  # -> Point, Parameter, Distance
area_53 = Area(Geometry=clean_57)  # -> Area, Centroid
area_54 = Area(Geometry=clean_55)  # -> Area, Centroid
crv_cp_4 = CurveClosestPoint(Point=area_53.Centroid, Curve=clean_58)  # -> Point, Parameter, Distance
ln_25 = Line(StartPoint=area_47.Centroid, EndPoint=area_51.Centroid)
ln_26 = Line(StartPoint=area_48.Centroid, EndPoint=area_52.Centroid)
ln_27 = Line(StartPoint=area_49.Centroid, EndPoint=area_54.Centroid)
ln_28 = Line(StartPoint=area_50.Centroid, EndPoint=crv_cp_3.Point)
ln_29 = Line(StartPoint=area_53.Centroid, EndPoint=crv_cp_4.Point)

crv_3 = Curve(move.Geometry)

boundary = BoundarySurfaces(Edges=crv_3)
area_55 = Area(Geometry=boundary)  # -> Area, Centroid
pdecon = Deconstruct(Point=area_55.Centroid)  # -> XComponent, YComponent, ZComponent
bnd = Bounds(Numbers=pdecon.ZComponent)
remap_2 = RemapNumbers(Value=pdecon.ZComponent, Source=bnd, Target=Domain(0, 1))  # -> Mapped, Clipped
graph = GraphMapper(
    remap_2.Mapped,
    x0=0,
    x1=1,
    y0=0,
    y1=1,
    container_name="Bezier",
    cpx=[0, 0.289855063, 0.75, 1],
    cpy=[0, 0.4306569099, 0.75, 1])
area_56 = Area(Geometry=boundary)  # -> Area, Centroid
gradient = Gradient(
    LowerLimit=0,
    UpperLimit=1,
    Parameter=graph,
    stops=[0: RGB(30, 27, 169), 0.287: RGB(0, 169, 48), 0.674: RGB(255, 132, 0), 1: RGB(220, 0, 40)])
tag = TextTag(Location=area_56.Centroid, Text=item_3)
preview = CustomPreview(Geometry=boundary, Material=gradient)  # disabled

item_4 = ListItem(List=area_56.Centroid, Index=Slider(2, range=0..10), Wrap=True)
galapagos = Galapagos(
    fitness=data,
    gene=[number_slider_2, number_slider_3, number_slider_4, number_slider_5, number_slider_7, number_slider_15, number_slider_16, number_slider_17, number_slider_18, number_slider_19, number_slider, number_slider_8, number_slider_9, number_slider_10, number_slider_11, number_slider_12, number_slider_13, number_slider_14, number_slider_21, number_slider_20, number_slider_6])
line = Line([ln, ln_2, ln_3, ln_4, ln_5, ln_6, ln_7, ln_8, ln_10, ln_12, ln_9, ln_11, ln_13, ln_14, ln_15, ln_16, ln_17, ln_18, ln_19, ln_21, ln_22, ln_23, ln_24, ln_20, ln_25, ln_27, ln_26, ln_28, ln_29])
devec = DeconstructVector(Vector=line)  # -> XComponent, YComponent, ZComponent
larger = LargerThan(FirstNumber=devec.ZComponent, SecondNumber=0)  # -> LargerThan, OrEqualTo
smaller = SmallerThan(FirstNumber=devec.ZComponent, SecondNumber=0)  # -> SmallerThan, OrEqualTo
ma = MassAddition(Input=devec.ZComponent)  # -> Result, PartialResults
data = Data(ma.Result)
cull = CullPattern(List=line, CullPattern=larger.LargerThan)
cull_2 = CullPattern(List=line, CullPattern=smaller.OrEqualTo)
panel_4 = Panel(data)
preview_2 = CustomPreview(Geometry=cull, Material=ColourSwatch(SwatchColor=RGB(255, 0, 0)))
preview_3 = CustomPreview(Geometry=cull_2, Material=ColourSwatch(SwatchColor=RGB(0, 102, 255)))
