# Grasshopper definition topos_opti_01.gh (Grasshopper 1.0.7)
# Copyright: Sebastian Białkowski
# plug-ins: tOpos, DendroGH, Pufferfish, Kangaroo2 Components

scale_factor_for_intersect = Slider(5, range=1..5)
absolute_thickness = Slider(3.23, range=0..5)

geo = Geometry(<brep referenced from the Rhino model>)
wires = BrepWireframe(Brep=geo, Density=-1)
mp = MultiPipe(NodeSize=0.5, EndOffset=1, StrutSize=1, Segment=0, KinkAngle=0.6, CubeFit=0)
meshcp = MeshClosestPoint()  # -> Point, Index, Parameter
panel = Panel("5")  # disabled
preview = CustomPreview(Material={diffuse=RGB(221, 160, 221), emission=RGB(66, 48, 66), shine=0.5, specular=RGB(255, 255, 255), transparency=0})

number_slider = Slider(10, range=0..50)  # disabled
number_slider_2 = Slider(1.5, range=0..1.5)  # disabled
srf = Surface(<surface referenced from the Rhino model>)  # disabled
pop2d = Populate2D(Region=srf, Count=number_slider, Seed=1)  # disabled
area = Area(Geometry=srf)  # -> Area, Centroid; disabled
scale = Scale(Geometry=srf, Center=area.Centroid, Factor=number_slider_2)  # -> Geometry, Transform; disabled
number_slider_3 = Slider(2, range=0..5)  # disabled
voronoi = Voronoi(Points=pop2d, Boundary=scale.Geometry, BruteForceOverride=False)  # disabled
pipe = Pipe(Curve=voronoi, Radius=number_slider_3, Caps=0)  # disabled
scale_2 = Scale(Geometry=voronoi, Center=pop2d, Factor=0.5)  # -> Geometry, Transform; disabled
join = BrepJoin(Breps=flatten(pipe))  # -> Breps, Closed; disabled

mesh = Mesh()
swatch = ColourSwatch(SwatchColor=RGB(255, 255, 255))
Z = UnitZ(Factor=Slider(22, range=0..100))

# ---- group: CUDA
reset_cuda = Button()
cudacontext = CudaCtx(Reset=reset_cuda)  # -> Performance, FreeMemory, KernelStatistics
free_memory_in_mb = Panel(cudacontext.FreeMemory)

# ---- group: Optimisation / General Setup
aparam = AnalyserParameters(Iterations=5000, Tolerance=0.001)

# ----
txt = Text(["193,95,63 (54)", "193,95,63 (54)", "193,95,63 (54)", "193,95,63 (54)", "193,95,63 (54)", "193,95,63 (54)"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])
pt = Point([Point(-8295.402344, -7307.058105, -3.490564346), Point(-8290.402344, -7307.058105, -3.490564346), Point(-8285.402344, -7307.058105, -3.490564346), Point(-8280.402344, -7307.058105, -3.490564346), Point(-8275.402344, -7307.058105, -3.490564346), Point(-8270.402344, -7307.058105, -3.490564346)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])
split = TextSplit(Text=txt, Separators="()")
item = ListItem(List=split, Index=1, Wrap=True)  # -> flatten(Item)
preview_2 = CustomPreview(Geometry=pt, Material=txt)
panel_2 = Panel(item)
bnd = Bounds(Numbers=item)
remap = RemapNumbers(Source=Domain(0, 1), Target=Domain(0, 1))  # -> Mapped, Clipped
remap_2 = RemapNumbers(Value=item, Source=bnd, Target=Domain(0, 1))  # -> Mapped, Clipped
graph = GraphMapper(
    remap_2.Mapped,
    x0=0,
    x1=1,
    y0=0,
    y1=1,
    container_name="Bezier",
    cpx=[0, 0.2125898749, 0.2336567342, 1],
    cpy=[0, 0.005064129829, 0.8642445803, 1])
remap_3 = RemapNumbers(Value=graph, Source=Domain(0, 1), Target="0 To 5")  # -> Mapped, Clipped
cir = Circle(Plane=pt, Radius=remap_3.Mapped)
txt_2 = Text(["0.074978", "0.074978", "0.074978", "0.074978", "0.074978", "0.074978"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])

geo_2 = Geometry([<brep referenced from the Rhino model> x26])
division = Division(A=scale_factor_for_intersect, B=absolute_thickness)

area_2 = Area(Geometry=geo_2)  # -> Area, Centroid
item_2 = ListItem(List=geo_2, Index=Slider(2, range=0..10), Wrap=True)

scale_3 = Scale(Geometry=geo_2, Center=area_2.Centroid, Factor=Slider(0.97, range=0..1.2))  # -> Geometry, Transform
wires_2 = BrepWireframe(Brep=scale_3.Geometry, Density=-1)  # -> simplify(Wireframe)

panel_3 = Panel(wires_2)
cull_i = CullIndex(List=wires_2, Indices=Slider(8, range=0..30), Wrap=True)

vsettings = CreateSettings(
    VoxelSize=Slider(1, range=0..5),
    Bandwidth=Slider(0.1, range=0..2),
    Isovalue=Slider(0.001, range=0..0.001),
    Adaptivity=Slider(0.4, range=0..1))
divlength = DivideLength(Curve=cull_i, Length=Slider(1, range=0..10))  # -> Points, Tangents, Parameters
vpoints = PointsToVolume(Points=divlength.Points, PointRadius=Slider(7, range=0..10), Settings=vsettings)  # -> flatten(Volume)
vunion = VolumeUnion(Volumes=vpoints)
mvolume = VolumeToMesh(Volume=vunion, VolumeSettings=vsettings)

crv = Curve(cull_i)
preview_3 = CustomPreview(
    Geometry=mvolume,
    Material={diffuse=RGB(221, 160, 221), emission=RGB(66, 48, 66), shine=0.5, specular=RGB(255, 255, 255), transparency=0})  # disabled
rebmsh = RebuildMesh(
    Mesh=mvolume,
    RebuildNormals=False,
    CullUnused=False,
    UnifyNormals=False,
    FlipNormals=False,
    IdenticalCombine=True,
    WeldVertices=0)
bbox = BoundingBox(Content=rebmsh, Plane=PlaneXY(0, 0, 0))  # -> Box, Box_2
debrep = DeconstructBrep(Brep=bbox.Box)  # -> Faces, Edges, Vertices
preview_4 = CustomPreview(
    Geometry=rebmsh,
    Material={diffuse=RGB(221, 160, 221), emission=RGB(66, 48, 66), shine=0.5, specular=RGB(255, 255, 255), transparency=0})  # disabled
item_3 = ListItem(List=debrep.Faces, Index=Slider(4, range=0..5), Wrap=True)
extr = Extrude(Base=item_3, Direction=Z)

geo_3 = Geometry(<brep referenced from the Rhino model>)
geo_4 = Geometry(rebmsh)
geo_5 = Geometry(extr)
mesh_2 = MeshBrep(
    Brep=geo_3,
    Settings={GridMaxCount=0, GridMinCount=16, JaggedSeams=False, MaxEdgeLength=0, MinEdgeLength=0.0001, MinTolerance=0, Refine=True, RefineAngle=0, RelativeTolerance=0.65, SimplePlanes=True, Tolerance=0})
mesh_3 = MeshBrep(
    Brep=geo_5,
    Settings={GridMaxCount=0, GridMinCount=16, JaggedSeams=False, MaxEdgeLength=0, MinEdgeLength=0.0001, MinTolerance=0, Refine=True, RefineAngle=0, RelativeTolerance=0.65, SimplePlanes=True, Tolerance=0})
panel_4 = Panel("200")

# ---- group: Model Creation / Domain and Mat. Properties
domain_bounding_box = Mesh(geo_4)
poisson = Slider(0.3, range=0..1)
young_ingpa = Slider(210, range=0..1000)
targetdens = Slider(0.7, range=0..1)
bdomain = BoundaryDomain(DomainMesh=domain_bounding_box, DensityValue=targetdens, YoungModul=young_ingpa, PoissonNumber=poisson)

# ---- group: Model Creation / Load And Support
number_slider_4 = Slider(500, range=0..1000)  # "kN/m3"
number_slider_5 = Slider(10, range=0..10)  # "kN/m2"
boxsurfload = Mesh(mesh_2)
torusvolload = Mesh(mesh_2)
Z_2 = UnitZ(Factor=expr("-x", "50000"))
sl = SurfaceLoad(LoadSurface=boxsurfload, LoadValue=number_slider_5)
vl = VolumeLoad(LoadMesh=boxsurfload, LoadVector=Z_2)

support_mesh = Mesh(mesh_3)
bcond = BoundaryConditions(Load=vl, Support=support_mesh)

# ---- group: Model Creation
res = Resolution(Size=Slider(5, range=0..100), sizeModeToggle=True)
model = Model(BoundaryDomain=bdomain, BoundaryCondition=bcond, ModelResolution=res, gpuModeToggle=True)  # -> Model, Performance

# ---- group: Optimisation / Good Setups. In penalisation I'm using continuation idea described by Bendsoe and Sigmund
oparam = OptimiusParameters(
    OptimisationIteration=Slider(2, range=0..100),
    VolumeFraction=targetdens,
    Penalty=Domain(2, 3),
    Change=0.005,
    SensitivityFilterRadius=Domain(1.5, 1.5),
    DensityFilterType=0,
    GrayScaleFilter=False,
    HeavisideProjection=0,
    SensitivityFilterType=1)

# ---- group: Optimisation
run = BooleanToggle(False)
reset = Button()
optimus = Optimus(
    Model=model.Model,
    AnalyserParameters=aparam,
    OptimusParameters=oparam,
    SubdivisionThreshold=0.5,
    Reset=reset,
    Run=run,
    optimisationPreviewMode=True,
    solverType=2)  # -> Model, Compliance, Performance

# ---- group: Optimisation process
graph_2 = QuickGraph(optimus.Compliance, SortOrder=0)  # disabled

# ---- group: Vis
number_slider_6 = Slider(0.442, range=0..1)  # disabled
number_slider_7 = Slider(0, range=0..10)
pstress = PrincipalStress(Model=optimus.Model, Tolerance=0)  # -> PStressValues, PStressPlane, PStressCrosses, PStressCrossesColours, PStressMinMax, VonMiesesValues, VonMiesesCrossesColours, Performance; disabled
iso = IsoMesh(Model=optimus.Model, IsoValue=number_slider_6, Deflection=0)  # disabled

# ----
mstat = ModelStatistics(Model=model.Model)  # -> ModelResolution, ElementCount, ElementSize, NodeCount, DoFs
panel_5 = Panel([mstat.ModelResolution, mstat.ElementCount, mstat.ElementSize, mstat.NodeCount, mstat.DoFs])
elepre = ElementDataPreview(model=optimus.Model, iso=0.02, move=number_slider_7)  # -> flatten(element_location), colours, colour_range
denspre = DensPreview(model=optimus.Model, iso=0.01)  # disabled
bang = ExplodeTree(Data=elepre.colours)  # -> Branch0, Branch1, Branch2

# ---- group: Performance Data
perf = Performance(Performance=optimus.Performance)  # -> TotalData, EventsNames, Times, Memory, Solver
panel_6 = Panel(perf.TotalData)

# ---- group: Nicer Preview for mesh
medges = MeshEdges(Mesh=iso)  # -> NakedEdges, InteriorEdges, NonManifoldEdges; disabled
swatch_2 = ColourSwatch(SwatchColor=RGB(0, 0, 0))  # disabled
swatch_3 = ColourSwatch(SwatchColor=RGB(255, 255, 255))  # disabled
merge = Merge(Data1=medges.NakedEdges, Data2=medges.InteriorEdges)  # disabled
entwine = Entwine(Branch00=merge, Branch01=iso, FlattenInputs=True)  # disabled
entwine_2 = Entwine(Branch00=swatch_2, Branch01=swatch_3, FlattenInputs=True)  # disabled
preview_5 = CustomPreview(Geometry=entwine, Shader=entwine_2)  # disabled

# ==== cluster DensPreview: Preview densities as a Blured Point Cloud
model = ClusterInput()  # tOpos Model
iso = ClusterInput()  # Iso Threshold
element = ElementData(Model=model, densityMode=False)  # -> Location, Density, Compliance, Sensitivity, Size
iso_2 = Number(iso)
larger = LargerThan(FirstNumber=element.Density, SecondNumber=iso_2)  # -> LargerThan, OrEqualTo
cull = CullPattern(List=element.Density, CullPattern=larger.LargerThan)
cull_2 = CullPattern(List=element.Location, CullPattern=larger.LargerThan)
gradient = Gradient(LowerLimit=0, UpperLimit=1, Parameter=cull, stops=[0: RGBA(255, 255, 255, 0), 0.462: RGB(0, 0, 0)])
cloud = CloudDisplay(Points=cull_2, Colours=gradient, Size=expr("x/2", element.Size), SpriteType=1)

# ==== cluster ElementDataPreview: Dot style preview of tOpos Model data including element Density, Compliance and Sensitivity
model = ClusterInput()  # tOpos Model to generate preview
iso = ClusterInput()  # Iso Threshold
move = ClusterInput()  # Space between particular data sets
M = Data(model)
iso_2 = Number(iso)
num = Number(move)
dom = ConstructDomain(DomainStart=0, DomainEnd=1)

element = ElementResult(Model=M, densityMode=False)  # -> Location, Density, Compliance, Sensitivity, Size
larger = LargerThan(FirstNumber=element.Density, SecondNumber=iso_2)  # -> LargerThan, OrEqualTo
dotsize = Slider(0.6, range=0..1)
cull = CullPattern(List=element.Location, CullPattern=larger.LargerThan)
multiplication = Multiplication(A=element.Size, B=dotsize)
bbox = BoundingBox(Content=cull, Plane=PlaneXY(0, 0, 0), UnionBox=True)  # -> Box, Box_2
boxprop = BoxProperties(Box=bbox.Box)  # -> Center, Diagonal, Area, Volume, Degeneracy
devec = DeconstructVector(Vector=boxprop.Diagonal)  # -> XComponent, YComponent, ZComponent
addition = Addition(A=num, B=devec.XComponent)
series = Series(Start=0, Step=addition, Count=3)
X = UnitX(Factor=series)
move_2 = Move(Geometry=cull, Motion=graft(X))  # -> simplify(Geometry), Transform

cull_2 = CullPattern(List=element.Density, CullPattern=larger.LargerThan)
gradient = Gradient(LowerLimit=0, UpperLimit=1, Parameter=cull_2, stops=[0: RGBA(255, 255, 255, 0), 1: RGB(0, 0, 0)])

bnd = Bounds(Numbers=element.Compliance)
cull_3 = CullPattern(List=element.Compliance, CullPattern=larger.LargerThan)
dedomain = DeconstructDomain(Domain=bnd)  # -> Start, End
gradient_2 = Gradient(
    LowerLimit=dedomain.Start,
    UpperLimit=dedomain.End,
    Parameter=cull_3,
    stops=[0.00371: RGBA(176, 53, 53, 0), 0.102: RGB(255, 250, 98), 0.5: RGB(46, 144, 208)])

bnd_2 = Bounds(Numbers=element.Sensitivity)
cull_4 = CullPattern(List=element.Sensitivity, CullPattern=larger.LargerThan)
dedomain_2 = DeconstructDomain(Domain=bnd_2)  # -> Start, End
gradient_3 = Gradient(
    LowerLimit=dedomain_2.Start,
    UpperLimit=dedomain_2.End,
    Parameter=cull_4,
    stops=[0.502: RGB(175, 53, 52), 0.895: RGB(255, 250, 98), 1: RGBA(46, 144, 209, 0)])

entwine = Entwine(Branch00=gradient, Branch01=gradient_2, Branch02=gradient_3, FlattenInputs=True)  # -> simplify(Result)

cloud = CloudDisplay(Points=move_2.Geometry, Colours=entwine, Size=multiplication, SpriteType=1)

pt = Point(cull)
col = Colour(entwine)
merge = Merge(Data1=flatten(dom), Data2=flatten(bnd), Data3=flatten(bnd_2))  # -> graft(Result)
range = Domain(merge)
element_location = ClusterOutput(pt)  # Element location (center) after culling by Iso parameter.
colours = ClusterOutput(col)  # Colous for each element (after culling by Iso Threshold) of particular data sets (dens, colpiance, sensitivity)
colour_range = ClusterOutput(range)  # Colour range of particular data sets (dens, colpiance, sensitivity) for creating legend
